# Grasshopper definition Stiegengelaender_Generator_alt.gh (Grasshopper 1.0.8)
# plug-ins: Volvox, Cordyceps

# ---- group: 01 - TREPPE
stufenzahl = Slider(13, range=1..40)
lauf = Slider(4000, range=500..20000)
trittbreite = Slider(1200, range=400..3000)
stufenstaerke = Slider(24, range=10..200)

# ---- group: 02 - GELAENDER
gelaenderhoehe = Slider(1000, range=800..1400)
untergurt_abstand = Slider(100, range=0..300)
fuellstab_abstand = Slider(115, range=50..132)

# ---- group: 03 - PROFILE
handlauf_profil = Slider(3, range=0..6)
posten_profil = Slider(2, range=0..7)
fuellstab_profil = Slider(3, range=0..5)
diagonal_profil = Slider(4, range=0..5)
untergurt_profil = Slider(0, range=0..6)

# ---- group: 04 - MONTAGE
montage_typ = Slider(0, range=0..1)
platte_breite = Slider(240, range=60..300)
platte_hoehe = Slider(321, range=100..400)
platte_breite_top = Slider(120, range=60..300)
platte_tiefe = Slider(120, range=60..300)
platte_dicke = Slider(10, range=6..20)
bolzen_durchmesser = Slider(12, range=8..20)
bolzen_laenge = Slider(100, range=50..200)
bolzen_offset_v = Slider(75, range=40..150)
bolzen_offset_xy = Slider(20, range=15..60)
fascia_offset = Slider(0, range=0..200)

# ---- group: 05 - FUELLUNG
fuellung_stil = Slider(1, range=0..2)
diagonal_seed = Slider(42, range=0..9999)
diagonal_dichte = Slider(300, range=50..400)
diagonal_auslage = Slider(40, range=0..100)

# ---- group: 06 - INTERN
const2 = Slider(1, range=0..4)
idx0 = Slider(0, range=0..10)
bolzen_masse_kg = Slider(0.12, range=0.05..0.3)

# ----
pta = ConstructPoint(XCoordinate="0", YCoordinate="0", ZCoordinate="0")
ptb = ConstructPoint(XCoordinate="4000", YCoordinate="0", ZCoordinate="2000")
_2 = Panel("2")
_0p5 = Panel("0.5")
_0p5_2 = Panel("-0.5")
t0p = Panel("0")
_0p5m = Panel("0.5")
_1m = Panel("1")
panel = Panel("-1")
_2m = Panel("2")
_1d = Panel("1")
_2d = Panel("2")
_3d = Panel("3")
panel_2 = Panel("-1")
_0d = Panel("0")
rho_mm3 = Panel("7.85e-06")
_1000b = Panel("1000")
t0u = Panel("0")
_2u = Panel("2")
_0p5u = Panel("0.5")
_0p5u_2 = Panel("-0.5")
_1000u = Panel("1000")
zerolen = Panel("0")
capd = Panel("112")
_2s = Panel("2")
_1s = Panel("1")
treppenbasislinie = Line(StartPoint=pta, EndPoint=ptb)
steigung_n = Division(A="2000", B=stufenzahl)
dichtesafe = Minimum(A=diagonal_dichte, B=capd)
isstil2 = Equality(FirstNumber=fuellung_stil, SecondNumber=_2s)  # -> Equality, Inequality
topboltlift = UnitZ(Factor=platte_dicke)
cat_h = Python3Script()  # -> out, gate, dimx, dimy, kgm
# ---------- cat_h: Python ----------
#! python 3
gate = [0, 0, 0, 1, 1, 1, 1]
dimx = [42.4, 33.7, 48.3, 40, 40, 40, 50]
dimy = [42.4, 33.7, 48.3, 40, 20, 10, 10]
kgm = [1.993, 1.564, 2.93, 2.386, 1.758, 3.14, 3.925]
# ---------- end cat_h ----------
cat_p = Python3Script()  # -> out, gate, dimx, dimy, kgm
# ---------- cat_p: Python ----------
#! python 3
gate = [1, 1, 1, 1, 0, 1, 1, 1]
dimx = [40, 50, 50, 60, 42.4, 50, 60, 80]
dimy = [40, 30, 50, 40, 42.4, 10, 10, 10]
kgm = [2.386, 2.386, 3.014, 4.427, 1.993, 3.925, 4.71, 6.28]
# ---------- end cat_p ----------
cat_i = Python3Script()  # -> out, gate, dimx, dimy, kgm
# ---------- cat_i: Python ----------
#! python 3
gate = [0, 0, 0, 1, 1, 1]
dimx = [12, 10, 14, 30, 40, 12]
dimy = [12, 10, 14, 5, 8, 12]
kgm = [0.888, 0.617, 1.208, 1.178, 2.512, 1.13]
# ---------- end cat_i ----------
cat_u = Python3Script()  # -> out, gate, dimx, dimy, kgm
# ---------- cat_u: Python ----------
#! python 3
gate = [1, 1, 1, 1, 1, 0, 0]
dimx = [40, 50, 60, 40, 40, 33.7, 12]
dimy = [10, 10, 10, 40, 20, 33.7, 12]
kgm = [3.14, 3.925, 4.71, 2.386, 1.758, 1.564, 0.888]
# ---------- end cat_u ----------
load = Load(Mask="x y z", Percent=1, Seed=123)
uzhand = UnitZ(Factor=gelaenderhoehe)
uzunter = UnitZ(Factor=untergurt_abstand)
dichteeff = StreamFilter(Gate=isstil2.Equality, Stream0=diagonal_dichte, Stream1=dichtesafe)
areafasc = Multiplication(A=platte_breite, B=platte_hoehe)
areatop = Multiplication(A=platte_breite_top, B=platte_tiefe)
zm = UnitZ(Factor=_1m)
uznosing = UnitZ(Factor=steigung_n)
stufenpunkte = DivideCurve(Curve=treppenbasislinie, Count=stufenzahl, Kinks=False)  # -> Points, Tangents, Parameters
mcp = Cordyceps(HttpPort=26929, DebugLevel=0)  # -> About, Status, LastCommand
ohne_fusspunkt = CullIndex(List=stufenpunkte.Points, Indices=idx0, Wrap=True)
tritt_lauf_n = Division(A=lauf, B=stufenzahl)
selgate_h = ListItem(List=cat_h.gate, Index=handlauf_profil, Wrap=True)
seldimx_h = ListItem(List=cat_h.dimx, Index=handlauf_profil, Wrap=True)
seldimy_h = ListItem(List=cat_h.dimy, Index=handlauf_profil, Wrap=True)
selkg_h = ListItem(List=cat_h.kgm, Index=handlauf_profil, Wrap=True)
selgate_p = ListItem(List=cat_p.gate, Index=posten_profil, Wrap=True)
seldimx_p = ListItem(List=cat_p.dimx, Index=posten_profil, Wrap=True)
seldimy_p = ListItem(List=cat_p.dimy, Index=posten_profil, Wrap=True)
selkg_p = ListItem(List=cat_p.kgm, Index=posten_profil, Wrap=True)
selgate_i = ListItem(List=cat_i.gate, Index=fuellstab_profil, Wrap=True)
seldimx_i = ListItem(List=cat_i.dimx, Index=fuellstab_profil, Wrap=True)
seldimy_i = ListItem(List=cat_i.dimy, Index=fuellstab_profil, Wrap=True)
selkg_i = ListItem(List=cat_i.kgm, Index=fuellstab_profil, Wrap=True)
selgate_u = ListItem(List=cat_u.gate, Index=untergurt_profil, Wrap=True)
seldimx_u = ListItem(List=cat_u.dimx, Index=untergurt_profil, Wrap=True)
seldimy_u = ListItem(List=cat_u.dimy, Index=untergurt_profil, Wrap=True)
selkg_u = ListItem(List=cat_u.kgm, Index=untergurt_profil, Wrap=True)
nosinglinie = Move(Geometry=treppenbasislinie, Motion=uznosing)  # -> Geometry, Transform
handlauflinie = Move(Geometry=nosinglinie.Geometry, Motion=uzhand)  # -> Geometry, Transform
untergurtlinie = Move(Geometry=nosinglinie.Geometry, Motion=uzunter)  # -> Geometry, Transform
areaplatte = StreamFilter(Gate=montage_typ, Stream0=areafasc, Stream1=areatop)
verton = SmallerThan(FirstNumber=fuellung_stil, SecondNumber=_2d)  # -> SmallerThan, OrEqualTo
diagon = LargerThan(FirstNumber=fuellung_stil, SecondNumber=_0d)  # -> LargerThan, OrEqualTo
tritt_2 = Division(A=tritt_lauf_n, B=const2)
breite_2 = Division(A=trittbreite, B=const2)
staerke_2 = Division(A=stufenstaerke, B=const2)
nosing_xyz = DeconstructPoint(Point=ohne_fusspunkt, System=PlaneXY(0, 0, 0))  # -> XCoordinate, YCoordinate, ZCoordinate
volplatte = Multiplication(A=areaplatte, B=platte_dicke)
untlen = Length(Curve=untergurtlinie.Geometry)
_1200 = Panel("1200")
x_tritt_2 = Subtraction(A=nosing_xyz.XCoordinate, B=tritt_2)
y_breite_2 = Subtraction(A=nosing_xyz.YCoordinate, B=breite_2)
z_staerke_2 = Subtraction(A=nosing_xyz.ZCoordinate, B=staerke_2)
frmh = PerpFrame(Curve=handlauflinie.Geometry, Parameter=t0p)
frmu = PerpFrame(Curve=untergurtlinie.Geometry, Parameter=t0u)
vamt0 = Multiplication(A=bolzen_offset_v, B=_1m)
vamt1 = Multiplication(A=bolzen_offset_v, B=panel)
insw_h = Multiplication(A=platte_breite_top, B=_0p5m)
insd_h = Multiplication(A=platte_tiefe, B=_0p5m)
kgproplatte = Multiplication(A=volplatte, B=rho_mm3)
l_1200 = Division(A=untlen, B=_1200)
posthoehe = Subtraction(A=gelaenderhoehe, B=untergurt_abstand)
insw = Subtraction(A=insw_h, B=bolzen_offset_xy)
amtt0 = Multiplication(A=insw, B=_1m)
amtt1 = Multiplication(A=insw, B=_1m)
amtt2 = Multiplication(A=insw, B=panel)
amtt3 = Multiplication(A=insw, B=panel)
insd = Subtraction(A=insd_h, B=bolzen_offset_xy)
amtn0 = Multiplication(A=insd, B=_1m)
amtn1 = Multiplication(A=insd, B=panel)
amtn2 = Multiplication(A=insd, B=_1m)
amtn3 = Multiplication(A=insd, B=panel)
tritt_mitte = ConstructPoint(XCoordinate=x_tritt_2, YCoordinate=y_breite_2, ZCoordinate=z_staerke_2)
diahalf_h = Division(A=seldimy_h, B=_2)
xhalfp_h = Multiplication(A=seldimx_h, B=_0p5)
xhalfn_h = Multiplication(A=seldimx_h, B=_0p5_2)
yhalfp_h = Multiplication(A=seldimy_h, B=_0p5)
yhalfn_h = Multiplication(A=seldimy_h, B=_0p5_2)
diahalf_p = Division(A=seldimy_p, B=_2)
xhalfp_p = Multiplication(A=seldimx_p, B=_0p5)
xhalfn_p = Multiplication(A=seldimx_p, B=_0p5_2)
yhalfp_p = Multiplication(A=seldimy_p, B=_0p5)
yhalfn_p = Multiplication(A=seldimy_p, B=_0p5_2)
diahalf_i = Division(A=seldimy_i, B=_2)
xhalfp_i = Multiplication(A=seldimx_i, B=_0p5)
xhalfn_i = Multiplication(A=seldimx_i, B=_0p5_2)
yhalfp_i = Multiplication(A=seldimy_i, B=_0p5)
yhalfn_i = Multiplication(A=seldimy_i, B=_0p5_2)
diahalf_u = Division(A=seldimy_u, B=_2u)
xhalfp_u = Multiplication(A=seldimx_u, B=_0p5u)
xhalfn_u = Multiplication(A=seldimx_u, B=_0p5u_2)
yhalfp_u = Multiplication(A=seldimy_u, B=_0p5u)
yhalfn_u = Multiplication(A=seldimy_u, B=_0p5u_2)
voff0 = UnitZ(Factor=vamt0)
voff1 = UnitZ(Factor=vamt1)
ux = UnitX(Factor=_1m)
uyneg = UnitY(Factor=panel)
round = Round(Number=l_1200)  # -> Nearest, Floor, Ceiling
circh = Circle(Plane=frmh, Radius=diahalf_h)
domx_h = ConstructDomain(DomainStart=xhalfn_h, DomainEnd=xhalfp_h)
domy_h = ConstructDomain(DomainStart=yhalfn_h, DomainEnd=yhalfp_h)
domx_p = ConstructDomain(DomainStart=xhalfn_p, DomainEnd=xhalfp_p)
domy_p = ConstructDomain(DomainStart=yhalfn_p, DomainEnd=yhalfp_p)
domx_i = ConstructDomain(DomainStart=xhalfn_i, DomainEnd=xhalfp_i)
domy_i = ConstructDomain(DomainStart=yhalfn_i, DomainEnd=yhalfp_i)
circu = Circle(Plane=frmu, Radius=diahalf_u)
domx_u = ConstructDomain(DomainStart=xhalfn_u, DomainEnd=xhalfp_u)
domy_u = ConstructDomain(DomainStart=yhalfn_u, DomainEnd=yhalfp_u)
teilerposten = DivideCurve(Curve=nosinglinie.Geometry, Count=round.Ceiling, Kinks=False)  # -> Points, Tangents, Parameters
topboltbase = Move(Geometry=teilerposten.Points, Motion=topboltlift)  # -> Geometry, Transform
evalbase = EvaluateCurve(Curve=untergurtlinie.Geometry, Parameter=teilerposten.Parameters)  # -> Point, Tangent, Angle
shath = Shatter(Curve=handlauflinie.Geometry, Parameters=teilerposten.Parameters)
edgenrm = CrossProduct(VectorA=zm, VectorB=evalbase.Tangent, Unitize=False)  # -> Vector, Length
edgen1 = UnitVector(Vector=edgenrm.Vector)
shatterunter = Shatter(Curve=untergurtlinie.Geometry, Parameters=teilerposten.Parameters)
seglend = Length(Curve=shatterunter)
ncell = Division(A=seglend, B=dichteeff)
tanhorizx = CrossProduct(VectorA=edgen1, VectorB=zm, Unitize=False)  # -> Vector, Length
nceil = Round(Number=ncell)  # -> Nearest, Floor, Ceiling
third = Division(A=nceil.Ceiling, B=_3d)
thirdn = Multiplication(A=third, B=panel_2)
nbays = ListLength(List=shatterunter)
seglen = Length(Curve=shatterunter)
divlo = DivideCurve(Curve=shatterunter, Count=nceil.Ceiling, Kinks=False)  # -> Points, Tangents, Parameters
divhi = DivideCurve(Curve=shath, Count=nceil.Ceiling, Kinks=False)  # -> Points, Tangents, Parameters
bayidx = Series(Start=_0d, Step=_1d, Count=nbays)
tanhoriz = UnitVector(Vector=tanhorizx.Vector)
vect0 = Amplitude(Vector=tanhoriz, Amplitude=amtt0)
vecn0 = Amplitude(Vector=edgen1, Amplitude=amtn0)
vect1 = Amplitude(Vector=tanhoriz, Amplitude=amtt1)
vecn1 = Amplitude(Vector=edgen1, Amplitude=amtn1)
vect2 = Amplitude(Vector=tanhoriz, Amplitude=amtt2)
vecn2 = Amplitude(Vector=edgen1, Amplitude=amtn2)
vect3 = Amplitude(Vector=tanhoriz, Amplitude=amtt3)
vecn3 = Amplitude(Vector=edgen1, Amplitude=amtn3)
shiftdom = ConstructDomain(DomainStart=thirdn, DomainEnd=third)
seedbay = Addition(A=diagonal_seed, B=bayidx)
seg_abstand = Division(A=seglen, B=fuellstab_abstand)
round3 = Round(Number=seg_abstand)  # -> Nearest, Floor, Ceiling
rndshift = Random(Range=shiftdom, Number=_1d, Seed=seedbay)
corner0 = Addition(A=vect0, B=vecn0)
corner1 = Addition(A=vect1, B=vecn1)
corner2 = Addition(A=vect2, B=vecn2)
corner3 = Addition(A=vect3, B=vecn3)
zdirpost = UnitZ(Factor=1)
recth = Rectangle(Plane=frmh, XSize=domx_h, YSize=domy_h, Radius=0)  # -> Rectangle, Length
rectu = Rectangle(Plane=frmu, XSize=domx_u, YSize=domy_u, Radius=0)  # -> Rectangle, Length
teilerfuell = DivideCurve(Curve=shatterunter, Count=round3.Ceiling, Kinks=False)  # -> Points, Tangents, Parameters
topboltpt0 = Move(Geometry=topboltbase.Geometry, Motion=corner0)  # -> Geometry, Transform
topboltpt1 = Move(Geometry=topboltbase.Geometry, Motion=corner1)  # -> Geometry, Transform
topboltpt2 = Move(Geometry=topboltbase.Geometry, Motion=corner2)  # -> Geometry, Transform
topboltpt3 = Move(Geometry=topboltbase.Geometry, Motion=corner3)  # -> Geometry, Transform
fw = Multiplication(A=platte_breite, B=_0p5m)
fh = Multiplication(A=platte_hoehe, B=_0p5m)
fhneg = Multiplication(A=fh, B=panel)
fdropvec = UnitZ(Factor=fhneg)
ft = Multiplication(A=platte_dicke, B=_0p5m)
fascamt = Addition(A=fascia_offset, B=ft)
fthickvec = Amplitude(Vector=edgen1, Amplitude=ft)
fascvec = Amplitude(Vector=edgen1, Amplitude=fascamt)
fascmove = Addition(A=fascvec, B=fdropvec)
fascpt = Move(Geometry=teilerposten.Points, Motion=fascmove)  # -> Geometry, Transform
boltbase = Move(Geometry=fascpt.Geometry, Motion=fthickvec)  # -> Geometry, Transform
fascpln = ConstructPlane(Origin=fascpt.Geometry, XAxis=tanhoriz, YAxis=zm)
boltpt0 = Move(Geometry=boltbase.Geometry, Motion=voff0)  # -> Geometry, Transform
boltpt1 = Move(Geometry=boltbase.Geometry, Motion=voff1)  # -> Geometry, Transform
boltpln0 = ConstructPlane(Origin=boltpt0.Geometry, XAxis=tanhoriz, YAxis=zm)
boltpln1 = ConstructPlane(Origin=boltpt1.Geometry, XAxis=tanhoriz, YAxis=zm)
rbolt = Division(A=bolzen_durchmesser, B=_2m)
tw = Multiplication(A=platte_breite_top, B=_0p5m)
td = Multiplication(A=platte_tiefe, B=_0p5m)
tt = Multiplication(A=platte_dicke, B=_0p5m)
topliftvec = UnitZ(Factor=tt)
toppt = Move(Geometry=teilerposten.Points, Motion=topliftvec)  # -> Geometry, Transform
toppln = ConstructPlane(Origin=toppt.Geometry, XAxis=tanhoriz, YAxis=edgen1)
shiftint = Round(Number=rndshift)  # -> Nearest, Floor, Ceiling
shiftabs = Absolute(Value=shiftint.Nearest)
shiftmag = Maximum(A=shiftabs, B=_1s)
posten = LineSDL(Start=teilerposten.Points, Direction=zdirpost, Length=gelaenderhoehe)
frmp = PerpFrame(Curve=posten, Parameter=t0p)
circp = Circle(Plane=frmp, Radius=diahalf_p)
rectp = Rectangle(Plane=frmp, XSize=domx_p, YSize=domy_p, Radius=0)  # -> Rectangle, Length
selsec_h = StreamFilter(Gate=selgate_h, Stream0=circh, Stream1=recth.Rectangle)
selsec_p = StreamFilter(Gate=selgate_p, Stream0=circp, Stream1=rectp.Rectangle)
selsec_u = StreamFilter(Gate=selgate_u, Stream0=circu, Stream1=rectu.Rectangle)
flatten = FlattenTree(Tree=teilerfuell.Points, Path="{0}")
topboltpln0 = ConstructPlane(Origin=topboltpt0.Geometry, XAxis=ux, YAxis=uyneg)
topboltpln1 = ConstructPlane(Origin=topboltpt1.Geometry, XAxis=ux, YAxis=uyneg)
topboltpln2 = ConstructPlane(Origin=topboltpt2.Geometry, XAxis=ux, YAxis=uyneg)
topboltpln3 = ConstructPlane(Origin=topboltpt3.Geometry, XAxis=ux, YAxis=uyneg)
fascplate = CenterBox(Base=fascpln, X=fw, Y=fh, Z=ft)
fascbolt0 = Cylinder(Base=boltpln0, Radius=rbolt, Length=bolzen_laenge)
fascbolt1 = Cylinder(Base=boltpln1, Radius=rbolt, Length=bolzen_laenge)
topplate = CenterBox(Base=toppln, X=tw, Y=td, Z=tt)
tol = Panel("0.1")
wrap0 = Panel("false")
hishift0 = ShiftList(List=divhi.Points, Shift=shiftmag, Wrap=wrap0)
wrap1 = Panel("false")
loshift1 = ShiftList(List=divlo.Points, Shift=shiftmag, Wrap=wrap1)
slpair0 = ShortestList(ListA=divlo.Points, ListB=hishift0, TrimMode=2)  # -> ListA, ListB
slpair1 = ShortestList(ListA=divhi.Points, ListB=loshift1, TrimMode=2)  # -> ListA, ListB
graftrail_h = GraftTree(Tree=handlauflinie.Geometry, IncludeEmptyLists=True, IncludeNullItems=True)
graftsec_h = GraftTree(Tree=selsec_h, IncludeEmptyLists=True, IncludeNullItems=True)
graftrail_p = GraftTree(Tree=posten, IncludeEmptyLists=True, IncludeNullItems=True)
graftsec_p = GraftTree(Tree=selsec_p, IncludeEmptyLists=True, IncludeNullItems=True)
graftrail_u = GraftTree(Tree=untergurtlinie.Geometry, IncludeEmptyLists=True, IncludeNullItems=True)
graftsec_u = GraftTree(Tree=selsec_u, IncludeEmptyLists=True, IncludeNullItems=True)
culldup = CullDuplicates(Points=flatten, Tolerance=tol, CullMode=3)  # -> Points, Indices, Valence
zdirfuell = UnitZ(Factor=1)
fascbolts = Merge(Data1=fascbolt0, Data2=fascbolt1)
topbolt0 = Cylinder(Base=topboltpln0, Radius=rbolt, Length=bolzen_laenge)
topbolt1 = Cylinder(Base=topboltpln1, Radius=rbolt, Length=bolzen_laenge)
topbolt2 = Cylinder(Base=topboltpln2, Radius=rbolt, Length=bolzen_laenge)
diagfwd = Line(StartPoint=slpair0.ListA, EndPoint=slpair0.ListB)
topbolt3 = Cylinder(Base=topboltpln3, Radius=rbolt, Length=bolzen_laenge)
diagbwd = Line(StartPoint=slpair1.ListB, EndPoint=slpair1.ListA)
lblb_d = Panel("Diagonalen Flachstahl: ")
lblb_p = Panel("Ankerplatten: ")
lblb_b = Panel("Bolzen M12: ")
unitb = Panel(" kg")
sweeph = Sweep1(Rail=graftrail_h, Sections=graftsec_h, Miter=1)
sweepp = Sweep1(Rail=graftrail_p, Sections=graftsec_p, Miter=1)
sweepu = Sweep1(Rail=graftrail_u, Sections=graftsec_u, Miter=1)
m_unter = Division(A=untlen, B=_1000u)
fuellstaebe = LineSDL(Start=culldup.Points, Direction=zdirfuell, Length=posthoehe)
vertikal_aktiv = CullPattern(List=fuellstaebe, CullPattern=verton.SmallerThan)
frmi = PerpFrame(Curve=fuellstaebe, Parameter=t0p)
circi = Circle(Plane=frmi, Radius=diahalf_i)
recti = Rectangle(Plane=frmi, XSize=domx_i, YSize=domy_i, Radius=0)  # -> Rectangle, Length
selsec_i = StreamFilter(Gate=selgate_i, Stream0=circi, Stream1=recti.Rectangle)
graftrail_i = GraftTree(Tree=vertikal_aktiv, IncludeEmptyLists=True, IncludeNullItems=True)
graftsec_i = GraftTree(Tree=selsec_i, IncludeEmptyLists=True, IncludeNullItems=True)
sweepi = Sweep1(Rail=graftrail_i, Sections=graftsec_i, Miter=1)
topb12 = Merge(Data1=topbolt0, Data2=topbolt1)
topb34 = Merge(Data1=topbolt2, Data2=topbolt3)
diaglines = Merge(Data1=diagfwd, Data2=diagbwd)
handlauf_volumen = CapHoles(Brep=sweeph)
posten_volumen = CapHoles(Brep=sweepp)
fuellstab_volumen = CapHoles(Brep=sweepi)
untergurt_volumen = CapHoles(Brep=sweepu)
kg_unter = Multiplication(A=m_unter, B=selkg_u)
treppe = CenterBox(Base=tritt_mitte, X=tritt_lauf_n, Y=trittbreite, Z=stufenstaerke)
topbolts = Merge(Data1=topb12, Data2=topb34)
auslvec = Amplitude(Vector=edgen1, Amplitude=diagonal_auslage)
diagflat = FlattenTree(Tree=diaglines, Path="{0}")
rhand = Panel("21.2")
capflat = Panel("1")
t0 = Panel("0")
panel_3 = Panel("-20")
_20 = Panel("20")
rfuell = Panel("6")
lblu = Panel("Untergurt: ")
unitu = Panel(" kg")
montage_platten = StreamFilter(Gate=montage_typ, Stream0=fascplate, Stream1=topplate)
nplatten = ListLength(List=montage_platten)
kg_platten = Multiplication(A=kgproplatte, B=nplatten)
cab_p = Concatenate(FragmentA=lblb_p, FragmentB=kg_platten)
cbb_p = Concatenate(FragmentA=cab_p, FragmentB=unitb)
montage_bolzen = StreamFilter(Gate=montage_typ, Stream0=fascbolts, Stream1=topbolts)
nbolzen = ListLength(List=montage_bolzen)
kg_bolzen = Multiplication(A=nbolzen, B=bolzen_masse_kg)
cab_b = Concatenate(FragmentA=lblb_b, FragmentB=kg_bolzen)
cbb_b = Concatenate(FragmentA=cab_b, FragmentB=unitb)
diagout = Move(Geometry=diagflat, Motion=auslvec)  # -> Geometry, Transform
cab_u = Concatenate(FragmentA=lblu, FragmentB=kg_unter)
diagonal_aktiv = CullPattern(List=diagout.Geometry, CullPattern=diagon.LargerThan)
len_diag = Length(Curve=diagonal_aktiv)
lenor0_d = Merge(Data1=len_diag, Data2=zerolen)
flatlen_d = FlattenTree(Tree=lenor0_d, Path="{0}")
sum_diag = MassAddition(Input=flatlen_d)  # -> Result, PartialResults
m_diag = Division(A=sum_diag.Result, B=_1000b)
cbb_u = Concatenate(FragmentA=cab_u, FragmentB=unitu)
seldimx_d = ListItem(List=cat_i.dimx, Index=diagonal_profil, Wrap=True)
seldimy_d = ListItem(List=cat_i.dimy, Index=diagonal_profil, Wrap=True)
selkg_d = ListItem(List=cat_i.kgm, Index=diagonal_profil, Wrap=True)
kg_diag = Multiplication(A=m_diag, B=selkg_d)
cab_d = Concatenate(FragmentA=lblb_d, FragmentB=kg_diag)
cbb_d = Concatenate(FragmentA=cab_d, FragmentB=unitb)
frmd = PerpFrame(Curve=diagonal_aktiv, Parameter=_0d)
_0p5d = Panel("0.5")
_0p5d_2 = Panel("-0.5")
dxhalfp = Multiplication(A=seldimx_d, B=_0p5d)
dxhalfn = Multiplication(A=seldimx_d, B=_0p5d_2)
dyhalfp = Multiplication(A=seldimy_d, B=_0p5d)
dyhalfn = Multiplication(A=seldimy_d, B=_0p5d_2)
ddomx = ConstructDomain(DomainStart=dxhalfn, DomainEnd=dxhalfp)
ddomy = ConstructDomain(DomainStart=dyhalfn, DomainEnd=dyhalfp)
len_hand = Length(Curve=handlauflinie.Geometry)
len_post = Length(Curve=posten)
len_fuell = Length(Curve=vertikal_aktiv)
lenor0_f = Merge(Data1=len_fuell, Data2=zerolen)
flatlen_f = FlattenTree(Tree=lenor0_f, Path="{0}")
_1000 = Panel("1000")
rectd = Rectangle(Plane=frmd, XSize=ddomx, YSize=ddomy, Radius=0)  # -> Rectangle, Length
graftraild = GraftTree(Tree=diagonal_aktiv, IncludeEmptyLists=True, IncludeNullItems=True)
graftsecd = GraftTree(Tree=rectd.Rectangle, IncludeEmptyLists=True, IncludeNullItems=True)
sum_hand = MassAddition(Input=len_hand)  # -> Result, PartialResults
sum_post = MassAddition(Input=len_post)  # -> Result, PartialResults
sum_fuell = MassAddition(Input=flatlen_f)  # -> Result, PartialResults
sweepd = Sweep1(Rail=graftraild, Sections=graftsecd, Miter=1)
m_hand = Division(A=sum_hand.Result, B=_1000)
m_post = Division(A=sum_post.Result, B=_1000)
m_fuell = Division(A=sum_fuell.Result, B=_1000)
rho_hand = Panel("1.993")
rho_post = Panel("2.386")
rho_fuell = Panel("0.888")
diagonal_volumen = CapHoles(Brep=sweepd)
kg_fuell = Multiplication(A=m_fuell, B=selkg_i)
kg_hand = Multiplication(A=m_hand, B=selkg_h)
kg_post = Multiplication(A=m_post, B=selkg_p)
addpu = Addition(A=kg_post, B=kg_unter)
addfh = Addition(A=kg_fuell, B=kg_hand)
kg_gesamt = Addition(A=addfh, B=addpu)
addtd = Addition(A=kg_gesamt, B=kg_diag)
addtp = Addition(A=addtd, B=kg_platten)
kg_gesamt_all = Addition(A=addtp, B=kg_bolzen)
lbl_f = Panel("Fuellstaebe Oe12: ")
lbl_h = Panel("Handlauf Oe42.4: ")
lbl_p = Panel("Posten 40x40: ")
unit = Panel(" kg")
lbl_t = Panel("GESAMT: ")
ca_f = Concatenate(FragmentA=lbl_f, FragmentB=kg_fuell)
ca_h = Concatenate(FragmentA=lbl_h, FragmentB=kg_hand)
ca_p = Concatenate(FragmentA=lbl_p, FragmentB=kg_post)
ca_t = Concatenate(FragmentA=lbl_t, FragmentB=kg_gesamt_all)
cb_f = Concatenate(FragmentA=ca_f, FragmentB=unit)
cb_h = Concatenate(FragmentA=ca_h, FragmentB=unit)
cb_p = Concatenate(FragmentA=ca_p, FragmentB=unit)
cb_t = Concatenate(FragmentA=ca_t, FragmentB=unit)
stueckliste_bom = Panel([cb_f, cb_h, cb_p, cb_t, cbb_d, cbb_p, cbb_b, cbb_u])
